vi "CreateMarker.gvi"   [LabVIEW NXG 5.0.0]
inputs:
  "index": i32
  "Error In": error
outputs:
  "Error Output": error
  "clientdatacluster out": "ClientDataCluster.gtype"
  "ClientData:GPS:Latitude": f64
  "ClientData:GPS:Longitude": f64
  "ClientData:SystemLinkClientInfo:TargetName": string
types:
  T1 = cluster{"Latitude": f64, "Longitude": f64, "Timestamp": string}
  T2 = cluster{"TargetName": string, "MinionID": string}
  T3 = cluster{"DistanceTraveled": f64, "CampaignProgress": f64, "Speed": f64, "Moving": bool}
  "MessageDataCluster.gtype" = cluster{"GPS": T1, "SystemLinkClientInfo": T2, "CampaignData": T3}
  "marker reference.gtype" = "NI.JavaScriptReference"
  "ClientDataCluster.gtype" = cluster{"ClientData": "MessageDataCluster.gtype", "References": cluster{"MarkerRef": "marker reference.gtype"}}
uses:
  DashboardUI::Modules::ProcessClientMessage.gvi
diagram:
  case ($"Error In") {
    frame Error, Default {
      w1 = $"Error In"
      w2 = default
      w3 = default
      w4 = default
      w5 = default
    }
    frame No Error {
      call "ProcessClientMessage.gvi"(index=$index, Error In=$"Error In", Command="GetClientByIndex") -> (ClientData out=w6, Error Out=w1)
      Property Node(instance in=w6) -> ("ClientData:GPS:Latitude"=w2, "ClientData:GPS:Longitude"=w3, "ClientData:SystemLinkClientInfo:TargetName"=w5, instance out=w4)
    }
  }
  $"Error Output" <- w1
  $"clientdatacluster out" <- w4
  $"ClientData:GPS:Latitude" <- w2
  $"ClientData:GPS:Longitude" <- w3
  $"ClientData:SystemLinkClientInfo:TargetName" <- w5
