vi "DeleteOldTags.gvi"   [LabVIEW NXG 5.0.0]
inputs:
  "Error In": error
  "configuration": "Configuration.gtype"
outputs:
  "Error Out": error
types:
  "Client Handle.gtype" = u32
  "Configuration.gtype" = cluster{"Server URL": string, "Session": "Client Handle.gtype", "Raw Session Queue": Queue<"Client Handle.gtype">}
uses:
  NI::Skyline::TagHTTP::Query Tags.gvi
  NI::Skyline::TagHTTP::Multi Read.gvi
  NI::Skyline::TagHTTP::Delete Tag (Single).gvi
diagram:
  case ($"Error In") {
    frame Error, Default {
      w1 = $"Error In"
    }
    frame No Error {
      call "Query Tags.gvi"(error in=$"Error In", configuration=$configuration) -> (tags=w2, error out=w3)
      call "Multi Read.gvi"(tags in=w2, error in=w3) -> (tags out=w4, tag clusters=w5, error out=w6)
      s1 = w6  # shift register
      for {
        w7 = each element of w5
        w8 = each element of w4
        Property Node(instance in=w7) -> ("Time Stamp"=w9)
        Get Current Time() -> (current time=w10)
        Timestamp Subtract(x=w10, y=w9) -> w11
        Is Greater(x=w11, y=360) -> w12
        disable {
          frame Disabled {
            w13 = s1
            w14 = w8
          }
          frame Enabled {
            case (w12) {
              frame False, Default {
                w13 = s1
                w14 = w8
              }
              frame True {
                call "Delete Tag (Single).gvi"(tag=w8, error in=s1) -> (error out=w13)
                w14 = default
              }
            }
          }
        }
        next s1 = w13
      }
      w1 = s1
    }
  }
  $"Error Out" <- w1
