vi "GetTimeSpan.gvi"   [LabVIEW NXG 5.0.0]
inputs:
  "TimeSpan": T1 = "1 Hour"
  "Error In": error
outputs:
  "Start Time": timestamp
  "End Time": timestamp
  "Error Out": error
types:
  T1 = enum{"1 Hour", "6 Hours", "12 Hours", "1 Day", "3 Days", "1 Week", "1 Month"}
diagram:
  case ($"Error In") {
    frame Error, Default {
      w1 = $"Error In"
      w2 = 1904-01-01T00:00:00Z
      w3 = 1904-01-01T00:00:00Z
    }
    frame No Error {
      Get Current Time() -> (current time=w3)
      Timestamp To Date And Time(time stamp=w3) -> (date time rec=w4)
      case ($TimeSpan) {
        frame "1 Hour", Default {
          Property Node(instance in=w4) -> ("hour"=w6, instance out=w7)
          Subtract(x=w6, y=1) -> w8
          Property Node(instance in=w7, "hour"=w8) -> (instance out=w5)
        }
        frame "6 Hours" {
          Property Node(instance in=w4) -> ("hour"=w9, instance out=w10)
          Subtract(x=w9, y=6) -> w11
          Property Node(instance in=w10, "hour"=w11) -> (instance out=w5)
        }
        frame "12 Hours" {
          Property Node(instance in=w4) -> ("hour"=w12, instance out=w13)
          Subtract(x=w12, y=12) -> w14
          Property Node(instance in=w13, "hour"=w14) -> (instance out=w5)
        }
        frame "1 Day" {
          Property Node(instance in=w4) -> ("day of month"=w15, instance out=w16)
          Subtract(x=w15, y=1) -> w17
          Property Node(instance in=w16, "day of month"=w17) -> (instance out=w5)
        }
        frame "3 Days" {
          Property Node(instance in=w4) -> ("day of month"=w18, instance out=w19)
          Subtract(x=w18, y=3) -> w20
          Property Node(instance in=w19, "day of month"=w20) -> (instance out=w5)
        }
        frame "1 Week" {
          Property Node(instance in=w4) -> ("day of month"=w21, instance out=w22)
          Subtract(x=w21, y=7) -> w23
          Property Node(instance in=w22, "day of month"=w23) -> (instance out=w5)
        }
        frame "1 Month" {
          Property Node(instance in=w4) -> ("month"=w24, instance out=w25)
          Subtract(x=w24, y=1) -> w26
          Property Node(instance in=w25, "month"=w26) -> (instance out=w5)
        }
      }
      Date And Time To Timestamp(date time rec=w5) -> (time stamp=w2)
      w1 = $"Error In"
    }
  }
  $"End Time" <- w3
  $"Start Time" <- w2
  $"Error Out" <- w1
