vi "GetValueFromTagList.gvi"   [LabVIEW NXG 5.1.0]
inputs:
  "tag clusters": "Tag Value Cluster.gtype"[] = [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]
  "Error In": error
outputs:
  "Error Out": error
  "TagValueClusters": "TagValueCluster.gtype"[]
  "Target Names": string[]
  "Target": string
panel indicators:
  "size(s)": i32
types:
  "DataType.gtype" = enum{"Double", "I32", "String", "Boolean", "U64", "Timestamp"}
  "Tag Value Cluster.gtype" = cluster{"Path": string, "Data Type": "DataType.gtype", "Value": string, "Time Stamp": timestamp}
  "TagValueCluster.gtype" = cluster{"Target": string, "Connected": string, "Last Communication": string, "CPU Usage": string, "RAM Usage": string, "Storage Usage": string, "Logging State": string, "System Start Time": string}
uses:
  NI::G Core::Strings::Search and Replace Pattern.gvi
diagram:
  # The correct value is returned by path. However, that value is not passed into the for loop
  case ($"Error In") {
    frame Error, Default {
      w1 = $"Error In"
      w2 = "TagValueCluster.gtype"[] []
      w3 = string[] []
    }
    frame No Error {
      Initialize Array(element="TagValueCluster.gtype" {all zero or empty}, size=1) -> w4
      # Removed logic in disable
      # structure to initialize
      # array based on number of
      # clusters to get for loop to
      # iterate once.
      s1 = w4  # shift register
      s2 = -1  # shift register
      for {
        w5 = each element of $"tag clusters"
        Array Size(array=s1) -> (size(s)=w6)
        Property Node(instance in=w5) -> ("Path"=w7, "Data Type"=w8, "Value"=w9, "Time Stamp"=w10)
        Match Pattern(regular expression="\\.", string=w7) -> (after substring=w11, before substring=w12)
        case (w8) {
          frame "Double", Default {
            Floating Point String To Number(string=w9) -> (number=w14)
            w13 = default
            w15 = default
          }
          frame "String" {
            w13 = w9
            w14 = default
            w15 = default
          }
          frame "Boolean" {
            Is Equal(x=w9, y="True") -> w15
            Format Date Time String(time stamp=w10) -> (date/time string=w13)
            w14 = default
          }
          frame "I32", "U64" {
            Decimal String To Number(string=w9) -> (number=w14)
            w13 = default
            w15 = default
          }
          frame "Timestamp" {
            w13 = w9
            w14 = default
            w15 = default
          }
        }
        s3 = s1  # shift register
        s4 = s2  # shift register
        for (N = w6) (iteration -> i1) {
          Array Index(array=s3) -> (out0[i1]=w16)
          Property Node(instance in=w16) -> ("Target"=w17, instance out=w18)
          Is Equal(x=w17, y=w12) -> w19
          # Target cluster not populating
          case (w19) {
            frame False, Default {
              w20 = w18
              w21 = s4
              w22 = w13
              w23 = w14
              w24 = w15
              w25 = w11
            }
            frame True {
              case (w11) {
                frame "System.Connected" {
                  Select(s=w15, t="Connected", f="Disconnected") -> w26
                  Property Node(instance in=w18, "Connected"=w26, "Last Communication"=w13) -> (instance out=w20)
                }
                frame "System.SystemStartTime" {
                  call "Search and Replace Pattern.gvi"(string=w13, pattern="T", replace string=" ") -> (result string=w27)
                  call "Search and Replace Pattern.gvi"(string=w27, pattern="Z", replace string="") -> (result string=w28)
                  Search Or Split String(search string/char=".", string=w28) -> (substring before match=w29)
                  Property Node(instance in=w18, "System Start Time"=w29) -> (instance out=w20)
                }
                frame "System.LoggingState" {
                  Property Node(instance in=w18, "Logging State"=w13) -> (instance out=w20)
                }
                frame "Health.Memory.UsePercentage" {
                  Number To Fractional String(number=w14, precision (6)=1) -> (F-format string=w30)
                  Property Node(instance in=w18, "RAM Usage"=w30) -> (instance out=w20)
                }
                frame "Health.CPU.MeanUsePercentage" {
                  Number To Fractional String(number=w14, precision (6)=1) -> (F-format string=w31)
                  Property Node(instance in=w18, "CPU Usage"=w31) -> (instance out=w20)
                }
                frame "Health.Disk.UsePercentage" {
                  Number To Fractional String(number=w14, precision (6)=1) -> (F-format string=w32)
                  Property Node(instance in=w18, "Storage Usage"=w32) -> (instance out=w20)
                }
                frame Default {
                  w20 = w18
                }
              }
              w21 = s4
              w22 = w13
              w23 = w14
              w24 = w15
              w25 = w11
            }
          }
          Replace Array Subset(inArray=s3, index=i1, new=w20) -> w33
          $Target <- w17
          next s3 = w33
          next s4 = w21
          stop if w19
        }
        case (w19) {
          frame False, Default {
            Increment(x=s4) -> w35
            Array Index(array=s3) -> (out0[w35]=w36)
            case (w25) {
              frame "System.Connected" {
                Select(s=w24, t="Connected", f="Disconnected") -> w38
                Property Node(instance in=w36, "Connected"=w38, "Last Communication"=w22, "Target"=w12) -> (instance out=w37)
              }
              frame "System.LoggingState" {
                Property Node(instance in=w36, "Logging State"=w22, "Target"=w12) -> (instance out=w37)
              }
              frame "System.SystemStartTime" {
                call "Search and Replace Pattern.gvi"(string=w22, pattern="T", replace string=" ") -> (result string=w39)
                call "Search and Replace Pattern.gvi"(string=w39, pattern="Z", replace string="") -> (result string=w40)
                Search Or Split String(search string/char=".", string=w40) -> (substring before match=w41)
                Property Node(instance in=w36, "System Start Time"=w41, "Target"=w12) -> (instance out=w37)
              }
              frame "Health.Memory.UsePercentage" {
                Number To Fractional String(number=w23, precision (6)=1) -> (F-format string=w42)
                Property Node(instance in=w36, "RAM Usage"=w42, "Target"=w12) -> (instance out=w37)
              }
              frame "Health.CPU.MeanUsePercentage" {
                Number To Fractional String(number=w23, precision (6)=1) -> (F-format string=w43)
                # #me
                Property Node(instance in=w36, "CPU Usage"=w43, "Target"=w12) -> (instance out=w37)
              }
              frame "Health.Disk.UsePercentage" {
                Number To Fractional String(number=w23, precision (6)=1) -> (F-format string=w44)
                Property Node(instance in=w36, "Storage Usage"=w44, "Target"=w12) -> (instance out=w37)
              }
              frame Default {
                w37 = w36
              }
            }
            Replace Array Subset(inArray=s3, index=w35, new=w37) -> w34
          }
          frame True {
            w34 = s3
            w35 = s4
          }
        }
        Array Size(array=w34) -> (size(s)=w45)
        $"size(s)" <- w45
        next s1 = w34
        next s2 = w35
      }
      for {
        w46 = each element of s1
        Property Node(instance in=w46) -> ("Target"=w47)
        append w47 to w3
      }
      w1 = $"Error In"
      w2 = s1
    }
  }
  $TagValueClusters <- w2
  $"Target Names" <- w3
  $"Error Out" <- w1
  disable {
    frame Enabled { }
    frame Disabled {
      Array Size() -> (size(s)=w48)
      Divide(x=w48, y=6)
      Sort 1D Array()
    }
  }
