vi "MarkersFGV.gvi"   [LabVIEW NXG 5.0.0]
inputs:
  "marker reference": "marker reference.gtype"
  "Error In": error
  "Command": T1 = "Reset"
  "index": i32
outputs:
  "marker reference_out": "marker reference.gtype"
  "Error Out": error
types:
  T1 = enum{"Reset", "GetMarkerByName", "GetMarkerByIndex", "SetMarkerRef"}
  "marker reference.gtype" = "NI.JavaScriptReference"
diagram:
  case ($"Error In") {
    frame Error, Default {
      w1 = $"Error In"
      w2 = "marker reference.gtype" constant
    }
    frame No Error {
      s1 = uninitialised  # shift register
      while {
        case ($Command) {
          frame "Reset", Default {
            w3 = "marker reference.gtype"[] []
            w2 = "marker reference.gtype" constant
          }
          frame "GetMarkerByName" {
            w3 = s1
            w2 = $"marker reference"
          }
          frame "GetMarkerByIndex" {
            Array Index(array=s1) -> (out0[$index]=w2)
            w3 = s1
          }
          frame "SetMarkerRef" {
            Array Size(array=s1) -> (size(s)=w4)
            Is Less(x=$index, y=w4) -> w5
            case (w5) {
              frame False, Default {
                Initialize Array(element="marker reference.gtype" constant, size=$index) -> w7
                Build Array(s1, w7) -> w6
              }
              frame True {
                w6 = s1
              }
            }
            Replace Array Subset(inArray=w6, index=$index, new=$"marker reference") -> w3
            w2 = $"marker reference"
          }
        }
        next s1 = w3
        stop if TRUE
      }
      w1 = $"Error In"
    }
  }
  $"marker reference_out" <- w2
  $"Error Out" <- w1
