vi "OnlineSystemsFGV.gvi"   [LabVIEW NXG 5.0.0]
inputs:
  "Command": "FGVCommand.gtype" = "Init"
  "Client": "ClientInfo.gtype"
  "Error In": error
outputs:
  "Error Out": error
  "AllClients": "ClientInfo.gtype"[]
  "Client out": "ClientInfo.gtype"
types:
  "FGVCommand.gtype" = enum{"Init", "AddClient", "RemoveClient", "Reset", "GetClient", "GetAllClients"}
  "ClientInfo.gtype" = cluster{"Name": string, "MinionID": string}
diagram:
  case ($"Error In") {
    frame Error, Default {
      w1 = $"Error In"
      w2 = "ClientInfo.gtype" {all zero or empty}
      w3 = "ClientInfo.gtype"[] []
    }
    frame No Error {
      s1 = uninitialised  # shift register
      while {
        case ($Command) {
          frame "Init", Default {
            w4 = "ClientInfo.gtype"[] []
            w1 = $"Error In"
            w2 = "ClientInfo.gtype" {all zero or empty}
          }
          frame "AddClient" {
            Search 1D Array(1D array=s1, element=$Client) -> (index of element=w5)
            Is Equal(x=w5, y=-1) -> w6
            case (w6) {
              frame False, Default {
                w4 = s1
                w2 = $Client
              }
              frame True {
                Build Array(s1, $Client) -> w4
                w2 = $Client
              }
            }
            w1 = $"Error In"
          }
          frame "RemoveClient" {
            Search 1D Array(1D array=s1, element=$Client) -> (index of element=w7)
            Is Not Equal(x=w7, y=-1) -> w8
            case (w8) {
              frame False, Default {
                w4 = s1
                w1 = $"Error In"
                w2 = $Client
              }
              frame True {
                Delete From Array(inArray=s1) -> (outArray=w4, deleted=w2)
                w1 = $"Error In"
              }
            }
          }
          frame "Reset" {
            w4 = "ClientInfo.gtype"[] []
            w1 = $"Error In"
            w2 = "ClientInfo.gtype" {all zero or empty}
          }
          frame "GetClient" {
            Property Node(instance in=$Client) -> ("Name"=w9, "MinionID"=w10)
            Is Empty String Or Path(string/path=w9) -> w11
            case (w11) {
              frame False, Default {
                for {
                  w12 = each element of s1
                  To Lower Case(string=w9) -> w13
                  Property Node(instance in=w12) -> ("Name"=w14, instance out=w2)
                  To Lower Case(string=w14) -> w15
                  Is Equal(x=w15, y=w13) -> w16
                  append w2 to w4
                  stop if w16
                }
              }
              frame True {
                for {
                  w17 = each element of s1
                  Property Node(instance in=w17) -> ("MinionID"=w18, instance out=w2)
                  Is Equal(x=w18, y=w10) -> w19
                  append w2 to w4
                  stop if w19
                }
              }
            }
            w1 = $"Error In"
          }
          frame "GetAllClients" {
            w4 = s1
            w1 = $"Error In"
            w2 = $Client
          }
        }
        next s1 = w4
        stop if TRUE
      }
      w3 = s1
    }
  }
  $AllClients <- w3
  $"Client out" <- w2
  $"Error Out" <- w1
