vi "ProcessClientMessage.gvi"   [LabVIEW NXG 5.1.0]
inputs:
  "Command": "ClientsFGVCmd.gtype" = "Reset"
  "ClientData": "MessageDataCluster.gtype"
  "Error In": error
  "ClientName in": string
  "index": i32
outputs:
  "Error Out": error
  "ClientData out": "ClientDataCluster.gtype"
  "ClientName": string
  "ClientIndex": i32
  "Found?": bool
types:
  T1 = cluster{"Latitude": f64, "Longitude": f64, "Timestamp": string}
  T2 = cluster{"TargetName": string, "MinionID": string}
  T3 = cluster{"DistanceTraveled": f64, "CampaignProgress": f64, "Speed": f64, "Moving": bool}
  "MessageDataCluster.gtype" = cluster{"GPS": T1, "SystemLinkClientInfo": T2, "CampaignData": T3}
  "ClientsFGVCmd.gtype" = enum{"Reset", "ProcessMessage", "GetClientByName", "GetClientByIndex", "SetActiveClient"}
  "marker reference.gtype" = "NI.JavaScriptReference"
  "ClientDataCluster.gtype" = cluster{"ClientData": "MessageDataCluster.gtype", "References": cluster{"MarkerRef": "marker reference.gtype"}}
  "MessageLoopData.gtype" = cluster{"Targets": string[], "TargetData": "ClientDataCluster.gtype"[]}
diagram:
  # ClientData is the data
  # displayed on the log screen
  case ($"Error In") {
    frame Error, Default {
      w1 = $"Error In"
      w2 = 0
      w3 = "ClientDataCluster.gtype" {all zero or empty}
      w4 = ""
      w5 = default
    }
    frame No Error {
      s1 = uninitialised  # shift register
      while {
        case ($Command) {
          frame "Reset", Default {
            w6 = "MessageLoopData.gtype" {all zero or empty}
            w2 = 0
            w3 = "ClientDataCluster.gtype" {all zero or empty}
            w4 = ""
            w5 = FALSE
          }
          frame "ProcessMessage" {
            # What is this targets data and what is it used for?
            Property Node(instance in=s1) -> ("Targets"=w7, instance out=w8)
            Property Node(instance in=$ClientData) -> ("SystemLinkClientInfo:MinionID"=w9, instance out=w10)
            Search 1D Array(1D array=w7, element=w9) -> (index of element=w11)
            case (w11) {
              frame Default {
                Property Node(instance in=w8) -> ("TargetData"=w12, instance out=w13)
                Array Index(array=w12) -> (out0[w11]=w14)
                Property Node(instance in=w14, "ClientData"=w10) -> (instance out=w3)
                Replace Array Subset(inArray=w12, index=w11, new=w3) -> w15
                Property Node(instance in=w13, "TargetData"=w15) -> (instance out=w6)
                Property Node(instance in=w14) -> ("References:MarkerRef"=w16)
                Is Not A Number Or Path Or Refnum(number=w16) -> w17
                Not(x=w17) -> w5
                w2 = w11
                w4 = w9
              }
              frame -1 {
                Property Node(instance in=w8) -> ("Targets"=w18, "TargetData"=w19, instance out=w20)
                Build Array(w18, w9) -> w21
                Property Node(instance in="ClientDataCluster.gtype" {all zero or empty}, "ClientData"=w10) -> (instance out=w3)
                Build Array(w19, w3) -> w22
                Property Node(instance in=w20, "Targets"=w21, "TargetData"=w22) -> (instance out=w6)
                Array Size(array=w22) -> (size(s)=w2)
                w4 = w9
                w5 = FALSE
              }
            }
          }
          frame "SetActiveClient" {
            w6 = s1
            w2 = $index
            w3 = "ClientDataCluster.gtype" {all zero or empty}
            w4 = $"ClientName in"
            w5 = default
          }
          frame "GetClientByName" {
            Property Node(instance in=s1) -> ("Targets"=w23, "TargetData"=w24, instance out=w6)
            Search 1D Array(1D array=w23, element=$"ClientName in") -> (index of element=w2)
            Array Index(array=w24) -> (out0[w2]=w3)
            Is Greater Or Equal To 0(x=w2) -> w5
            w4 = $"ClientName in"
          }
          frame "GetClientByIndex" {
            Property Node(instance in=s1) -> ("Targets"=w25, "TargetData"=w26, instance out=w6)
            Array Index(array=w26) -> (out0[$index]=w3)
            Array Index(array=w25) -> (out0[$index]=w4)
            Is Empty String Or Path(string/path=w4) -> w27
            Not(x=w27) -> w5
            w2 = $index
          }
        }
        next s1 = w6
        stop if TRUE
      }
      w1 = $"Error In"
    }
  }
  $ClientName <- w4
  $"ClientData out" <- w3
  $ClientIndex <- w2
  $"Found?" <- w5
  $"Error Out" <- w1
