vi "GetHealthHistory.gvi"   [LabVIEW NXG 5.0.0]
inputs:
  "TagValues": "Tag History.gtype"[]
  "error in": error
outputs:
  "error out": error
  "HealthHistory": "HealthHistory.gtype"
types:
  "HealthHistory.gtype" = cluster{"Target": string, "CPUUsage": f64[], "RAMUsage": f64[], "StorageUsage": f64[], "Timestamps": timestamp[]}
  "DataType.gtype" = enum{"Double", "I32", "String", "Boolean", "U64", "Timestamp"}
  "Tag History.gtype" = cluster{"Path": string, "Data Type": "DataType.gtype", "Values": string[], "Time Stamps": timestamp[]}
diagram:
  case ($"error in") {
    frame Error, Default {
      w1 = $"error in"
      w2 = default
    }
    frame No Error {
      s1 = "HealthHistory.gtype" {all zero or empty}  # shift register
      for {
        w3 = each element of $TagValues
        Property Node(instance in=w3) -> ("Values"=w4, "Path"=w5, "Time Stamps"=w6)
        Floating Point String To Number(string=w4) -> (number=w7)
        Match Pattern(regular expression="\\.Health\\.", string=w5) -> (after substring=w8, before substring=w9)
        case (w8) {
          frame "Disk.UsePercentage", Default {
            Property Node(instance in=s1, "Target"=w9, "StorageUsage"=w7, "Timestamps"=w6) -> (instance out=w10)
          }
          frame "Memory.UsePercentage" {
            Property Node(instance in=s1, "Target"=w9, "RAMUsage"=w7, "Timestamps"=w6) -> (instance out=w10)
          }
          frame "CPU.MeanUsePercentage" {
            Property Node(instance in=s1, "Target"=w9, "CPUUsage"=w7, "Timestamps"=w6) -> (instance out=w10)
          }
        }
        next s1 = w10
      }
      w1 = $"error in"
      w2 = s1
    }
  }
  $HealthHistory <- w2
  $"error out" <- w1
