vi "GetHealthTagPaths.gvi"   [LabVIEW NXG 5.0.0]
inputs:
  "Fleet Table": "TagValueCluster.gtype"[]
  "Tags": "Tag.gtype"[]
  "index": i32
  "Error In": error
outputs:
  "Tags out": "Tag.gtype"[]
  "Error Out": error
types:
  "DataType.gtype" = enum{"Double", "I32", "String", "Boolean", "U64", "Timestamp"}
  "Client Handle.gtype" = u32
  "Configuration.gtype" = cluster{"Server URL": string, "Session": "Client Handle.gtype", "Raw Session Queue": Queue<"Client Handle.gtype">}
  "Tag.gtype" = cluster{"Path": string, "Datatype": "DataType.gtype", "Configuration": "Configuration.gtype"}
  "TagValueCluster.gtype" = cluster{"Target": string, "Connected": string, "Last Communication": string, "CPU Usage": string, "RAM Usage": string, "Storage Usage": string, "Logging State": string, "System Start Time": string}
diagram:
  case ($"Error In") {
    frame Error, Default {
      w1 = "Tag.gtype"[] []
      w2 = $"Error In"
    }
    frame No Error {
      w3 = [".Health.CPU.MeanUsePercentage", ".Health.Disk.UsePercentage", ".Health.Memory.UsePercentage"]
      Array Index(array=$"Fleet Table") -> (out0[$index]=w4)
      Property Node(instance in=w4) -> ("Target"=w5)
      for {
        w6 = each element of $Tags
        for {
          w7 = each element of w3
          Property Node(instance in=w6) -> ("Path"=w9, instance out=w10)
          Concatenate Strings(w5, w7) -> w11
          Is Equal(x=w9, y=w11) -> w12
          append w10 to w8 if w12
        }
        concatenate w8 onto w1
      }
      w2 = $"Error In"
    }
  }
  $"Tags out" <- w1
  $"Error Out" <- w2
