vi "GetOnlineSystems.gvi"   [LabVIEW NXG 5.1.0]
# This VI looks for the .system.connected tag and returns an array of connected systems as well as the length of that array (number of connected systems)
inputs:
  "tags": "Tag.gtype"[]
  "Error In": error
outputs:
  "Online Systems": string[]
  "Error Out": error
  "Number of Systems": i32
types:
  "DataType.gtype" = enum{"Double", "I32", "String", "Boolean", "U64", "Timestamp"}
  "Client Handle.gtype" = u32
  "Configuration.gtype" = cluster{"Server URL": string, "Session": "Client Handle.gtype", "Raw Session Queue": Queue<"Client Handle.gtype">}
  "Tag.gtype" = cluster{"Path": string, "Datatype": "DataType.gtype", "Configuration": "Configuration.gtype"}
diagram:
  case ($"Error In") {
    frame Error, Default {
      w1 = $"Error In"
      w2 = string[] []
      w3 = 0
    }
    frame No Error {
      for {
        w4 = each element of $tags
        Property Node(instance in=w4) -> ("Path"=w5)
        Match Pattern(regular expression=".System.Connected", string=w5) -> (before substring=w6, match substring=w7)
        Is Empty String Or Path(string/path=w7) -> w8
        Not(x=w8) -> w9
        append w6 to w2 if w9
      }
      Array Size(array=w2) -> (size(s)=w3)
      w1 = $"Error In"
    }
  }
  $"Online Systems" <- w2
  $"Number of Systems" <- w3
  $"Error Out" <- w1
