vi "UpdateMarker.gvi"   [LabVIEW NXG 5.0.0]
inputs:
  "Error In": error
  "ClientIndex": i32
outputs:
  "Error Out": error
uses:
  DashboardUI::Modules::MarkersFGV.gvi
  DashboardUI::Modules::ProcessClientMessage.gvi
  GoogleMap::Marker::Set Marker Position.gvi
diagram:
  case ($"Error In") {
    frame Error, Default {
      w1 = $"Error In"
    }
    frame No Error {
      call "MarkersFGV.gvi"(index=$ClientIndex, Error In=$"Error In", Command="GetMarkerByIndex") -> (marker reference_out=w2, Error Out=w3)
      call "ProcessClientMessage.gvi"(index=$ClientIndex, Error In=w3, Command="GetClientByIndex") -> (ClientData out=w4, Error Out=w5)
      Property Node(instance in=w4) -> ("ClientData:GPS:Latitude"=w6, "ClientData:GPS:Longitude"=w7)
      call "Set Marker Position.gvi"(marker=w2, latitude=w6, longitude=w7, error in=w5) -> (error out=w1)
    }
  }
  $"Error Out" <- w1
