vi "UpdateMarkerRef.gvi"   [LabVIEW NXG 5.0.0]
inputs:
  "Error In": error
  "References:MarkerRef": "marker reference.gtype"
  "clientdatacluster in": "ClientDataCluster.gtype"
  "index": i32
outputs:
  "Error Out": error
types:
  "marker reference.gtype" = "NI.JavaScriptReference"
  T1 = cluster{"Latitude": f64, "Longitude": f64, "Timestamp": string}
  T2 = cluster{"TargetName": string, "MinionID": string}
  T3 = cluster{"DistanceTraveled": f64, "CampaignProgress": f64, "Speed": f64, "Moving": bool}
  "MessageDataCluster.gtype" = cluster{"GPS": T1, "SystemLinkClientInfo": T2, "CampaignData": T3}
  "ClientDataCluster.gtype" = cluster{"ClientData": "MessageDataCluster.gtype", "References": cluster{"MarkerRef": "marker reference.gtype"}}
uses:
  DashboardUI::Modules::ProcessClientMessage.gvi
diagram:
  case ($"Error In") {
    frame Error, Default {
      w1 = $"Error In"
    }
    frame No Error {
      Property Node(instance in=$"clientdatacluster in", "References:MarkerRef"=$"References:MarkerRef") -> (instance out=w2)
      call "ProcessClientMessage.gvi"(ClientData in=w2, index=$index, Error In=$"Error In", Command="SetActiveClient") -> (Error Out=w1)
    }
  }
  $"Error Out" <- w1
